# Grasshopper definition HU2.ghx (Grasshopper 1.0.8)
# Copyright: 2024
# plug-ins: RhinoCodePluginGH

# ----
# HU2
number_slider = Slider(24, range=0..100)
number_slider_2 = Slider(14, range=0..100)
number_slider_3 = Slider(0.5, range=0..1)

galapagos = Galapagos(fitness=volume, gene=number_slider_3)
range = Range(Domain=Domain(0, 1), Steps=number_slider_2)
graph = GraphMapper(range, x0=0, x1=1, y0=0, y1=1, container_name="Bezier", cpx=[0, 0.282954812, 0.6886360645, 1], cpy=[0, 0, 1, 1])
graph_2 = GraphMapper(range, x0=0, x1=1, y0=0, y1=1, container_name="Bezier", cpx=[0, 0.25, 0.75, 1], cpy=[0, 0.25, 0.75, 1])
X = UnitX(Factor=1)

crv = Curve(<curve referenced from the Rhino model>)
end = EndPoints(Curve=crv)  # -> Start, End
item = ListItem(List=end.End, Index=0, Wrap=True)
pdecon = Deconstruct(Point=item)  # -> XComponent, YComponent, ZComponent

length_start = Slider(85, range=0..100)
length_width_end = Slider(15, range=0..100)
width_start = Slider(25, range=0..100)
dom = ConstructDomain(DomainStart=length_start, DomainEnd=length_width_end)
dom_2 = ConstructDomain(DomainStart=width_start, DomainEnd=length_width_end)
range_2 = Range(Domain=Domain(1, 0), Steps=number_slider_2)
range_3 = Range(Domain=Domain(1, 0), Steps=number_slider_2)
graph_3 = GraphMapper(range_2, x0=0, x1=1, y0=0, y1=1, container_name="Bezier", cpx=[0, 0.25, 0.75, 1], cpy=[0, 0.25, 0.75, 1])
graph_4 = GraphMapper(range_3, x0=0, x1=1, y0=0, y1=1, container_name="Bezier", cpx=[0, 0.25, 0.75, 1], cpy=[0, 0.25, 0.75, 1])
remap = RemapNumbers(Value=graph_3, Source=Domain(1, 0), Target=dom)  # -> expr("x/2", Mapped), Clipped
remap_2 = RemapNumbers(Value=graph_4, Source=Domain(1, 0), Target=dom_2)  # -> Mapped, Clipped

remap_3 = RemapNumbers(Value=Slider(0, range=0..1), Source=Domain(0, 1), Target=number_slider_2)  # -> Mapped, Clipped
range_max_position = CSharpScript(steps=number_slider_2, maxPosition=remap_3.Mapped)  # -> R; inputs steps: Int32, maxPosition: Int32
# ---------- range_max_position: C# ----------
// Grasshopper Script Instance
#region Usings
using System;
using System.Linq;
using System.Collections;
using System.Collections.Generic;
using System.Drawing;

using Rhino;
using Rhino.Geometry;

using Grasshopper;
using Grasshopper.Kernel;
using Grasshopper.Kernel.Data;
using Grasshopper.Kernel.Types;
#endregion

public class Script_Instance : GH_ScriptInstance
{
    #region Notes
    /* 
      Members:
        RhinoDoc RhinoDocument
        GH_Document GrasshopperDocument
        IGH_Component Component
        int Iteration

      Methods (Virtual & overridable):
        Print(string text)
        Print(string format, params object[] args)
        Reflect(object obj)
        Reflect(object obj, string method_name)
    */
    #endregion

    private void RunScript(int steps, int maxPosition, ref object R)
    {
            
        if (maxPosition == null){
            maxPosition = steps;
        }

        float[] floatRange = GenerateFloatRange(steps, maxPosition);
        
        // Print the resulting array
        R = floatRange;


        static float[] GenerateFloatRange(int steps, int maxPosition)
        {
            steps++;
            
            if (maxPosition < 0 || maxPosition >= steps)
            {
                throw new ArgumentException("maxPosition should be between 0 and steps - 1");
            }

            // Create arrays for the two parts: before and after the maximum
            float[] rangeBeforeMax = Linspace(0, 1, maxPosition + 1);
            float[] rangeAfterMax = Linspace(1, 0, steps - maxPosition);

            // Concatenate them into a single array
            float[] result = new float[steps];
            Array.Copy(rangeBeforeMax, 0, result, 0, maxPosition);
            Array.Copy(rangeAfterMax, 0, result, maxPosition, steps - maxPosition);

            return result;
        }

        static float[] Linspace(float start, float end, int num)
        {
            float[] result = new float[num];
            float step = (end - start) / (num - 1);

            for (int i = 0; i < num; i++)
            {
                result[i] = start + step * i;
            }

            return result;
        }
    }
}
# ---------- end range_max_position ----------
graph_5 = GraphMapper(range_max_position, x0=0, x1=1, y0=0, y1=1, container_name="Bezier", cpx=[0, 0.25, 0.75, 1], cpy=[0, 0.25, 0.75, 1])

chamfer_start = Slider(7.83, range=0..100)
chamfer_end = Slider(4.5, range=0..100)
dom_3 = ConstructDomain(DomainStart=chamfer_start, DomainEnd=chamfer_end)
range_4 = Range(Domain=dom_3, Steps=number_slider_2)  # -> graft(Range)

inner_convexity = Slider(17.49, range=0..100)
range_5 = Range(Domain=Domain(1, 0), Steps=number_slider_2)
graph_6 = GraphMapper(range_5, x0=0, x1=1, y0=0, y1=1, container_name="Gaussian", factor=0.3271082044, mean=0.6906322241, sdev=0.1327042878)
dom_4 = ConstructDomain(DomainStart=inner_convexity, DomainEnd=0)
remap_4 = RemapNumbers(Value=graph_6, Source=Domain(1, 0), Target=dom_4)  # -> Mapped, Clipped

toggle = BooleanToggle(True)

bend = Slider(12, range=0..100)
x_segements = Slider(4, range=1..100)
y_segements = Slider(2, range=1..10)

parabola = Python3Script(N=x_segements, D="1", Inv="1")  # -> R; inputs N: Int32, D: Int32, Inv: Boolean; same code as parabola
range_6 = Range(Domain=Domain(0, 1), Steps=x_segements)
graph_7 = GraphMapper(range_6, x0=0, x1=1, y0=0, y1=1, container_name="Gaussian", factor=0.4075372815, mean=0.472511977, sdev=0.165032953)

panel = Panel(graph_5)

# ---- group: HU2
data = Data(Tree({0;0}: [Plane(origin=(101, 0, 0), x=(1, 0, 0), y=(0, 0.9804661629, 0.1966878324)), Plane(origin=(101, -1.447780466, 8.363830626), x=(1, 0, 0), y=(0, 0.9895312097, 0.144319039)), Plane(origin=(101, -3.074681583, 27.61901513), x=(1, 0, 0), y=(0, 0.9997177919, 0.02375576809)), Plane(origin=(101, -1.802444844, 51.88351619), x=(1, 0, 0), y=(0, 0.9917518842, -0.1281725406)), Plane(origin=(101, 3.455695827, 76.76827431), x=(1, 0, 0), y=(0, 0.9588288739, -0.2839844901)), Plane(origin=(101, 11.6948858, 98.58912421), x=(1, 0, 0), y=(0, 0.9072404981, -0.4206122663)), Plane(origin=(101, 20.02738753, 114.2253652), x=(1, 0, 0), y=(0, 0.8550678657, -0.5185160991)), Plane(origin=(101, 24, 120.4474378), x=(1, 0, 0), y=(0, 0.8301939855, -0.5574746151))], {0;1}: [27.4853217, 39.40552541, 42.98121591, 32.54782695, 21.67760053, 13.26796705, 8.752987241, 7.323962904], {0;2}: [25, 23.57142857, 22.14285714, 20.71428571, 19.28571429, 17.85714286, 16.42857143, 15], {0;3}: [3], {0;4}: [2], {0;5}: [10.52], {0;6}: ["1", "0.857143", "0.714286", "0.571429", "0.428571", "0.285714", "0.142857", "0"], {0;7}: [5.04, 4.891428571, 4.742857143, 4.594285714, 4.445714286, 4.297142857, 4.148571429, 4], {0;8}: [0.07329835393, 1.380404542, 8.158841859, 15.13424043, 8.810543928, 1.609736496, 0.09230321716, 0.001661073554], {0;9}: [0.009540885584, 0.5822379757, 0.6009944359, 0.01049297062]))

# ----
neg = Negative(Value=Slider(4.28, range=0..10))
height = Slider(3, range=0..10)
radius = Slider(5, range=0..10)
gap = Slider(2.1, range=0..10)
Y = UnitY(Factor=Slider(22, range=0..100))

# ---- group: Switch input type
dispatch = Dispatch(List=Slider(113, range=0..1000), DispatchPattern=invert(toggle))  # -> ListA, ListB
dispatch_2 = Dispatch(List=remap.Mapped, DispatchPattern=invert(toggle))  # -> ListA, ListB
dispatch_3 = Dispatch(List=pdecon.ZComponent, DispatchPattern=toggle)  # -> ListA, ListB
merge = Merge(Data1=dispatch_3.ListA, Data2=dispatch.ListA)

# ----
c_script = CSharpScript(y=number_slider, z=merge, Mt=Slider(0.428, range=0..1), T=Slider(12.117, range=0..100), t=graph_2)  # -> A, F; inputs x: Double, y: Double, z: Double, Mt: Double, T: Double, t: list of Double
# ---------- c_script: C# ----------
// Grasshopper Script Instance
#region Usings
using System;
using System.Linq;
using System.Collections;
using System.Collections.Generic;
using System.Drawing;

using Rhino;
using Rhino.Geometry;

using Grasshopper;
using Grasshopper.Kernel;
using Grasshopper.Kernel.Data;
using Grasshopper.Kernel.Types;
#endregion

public class Script_Instance : GH_ScriptInstance
{
    #region Notes
    /* 
      Members:
        RhinoDoc RhinoDocument
        GH_Document GrasshopperDocument
        IGH_Component Component
        int Iteration

      Methods (Virtual & overridable):
        Print(string text)
        Print(string format, params object[] args)
        Reflect(object obj)
        Reflect(object obj, string method_name)
    */
    #endregion

    private void RunScript(
	double x,
	double y,
	double z,
	double Mt,
	double T,
	List<double> t,
	ref object A,
	ref object F)
    {
        Point3d pt1 = Point3d.Origin;
        Point3d pt2 = new Point3d(0, y, z);
        Line ln = new Line(pt1, pt2);
        Point3d mid = ln.PointAt(Mt);
        Vector3d vec = new Vector3d(0, -T, 0);
        mid += vec;
        Arc arc = new Arc(pt1, mid, pt2);
        A = arc;
        
        List<Plane> frame = new List<Plane>();
        Curve crv = arc.ToNurbsCurve();
        Interval intv = new Interval(0, 1);
        crv.Domain = intv;
        foreach (var item in t)
        {
            Plane pl = new Plane(crv.PointAt(item), crv.TangentAt(item));
            frame.Add(pl);
        }
        F = frame;

    }
}
# ---------- end c_script ----------
pframe = PerpFrame(Curve=reparameterize(c_script.A), Parameter=number_slider_3)
align = AlignPlane(Plane=c_script.F, Direction=X)  # -> Plane, Angle
cluster = Cluster_2(C=crv, P=align.Plane)

# ---- group: Switch input type (continued)
dispatch_4 = Dispatch(List=cluster, DispatchPattern=toggle)  # -> ListA, ListB
entwine = Entwine(Branch00=dispatch_4.ListA, Branch01=dispatch_2.ListA, FlattenInputs=True)
clean = CleanTree(RemoveNulls=True, RemoveInvalid=True, RemoveEmpty=True, Tree=entwine)

# ----
entwine_2 = Entwine(
    Branch00=align.Plane,
    Branch01=clean,
    Branch02=remap_2.Mapped,
    Branch03=x_segements,
    Branch04=y_segements,
    Branch05=bend,
    Branch06=panel,
    Branch07=range_4,
    Branch08=remap_4.Mapped,
    Branch09=graph_7,
    FlattenInputs=True)
data_2 = Data(entwine_2)
bang = ExplodeTree(Data=entwine_2)  # -> Branch0, Branch1, Branch2, Branch3, Branch4, Branch5, Branch6, graft(Branch7), Branch8, Branch9
cluster_2 = Cluster(
    plane=bang.Branch0,
    length_range=bang.Branch1,
    width_range=bang.Branch2,
    x_segements=bang.Branch3,
    y_segements=bang.Branch4,
    bend=bang.Branch5,
    bend_graph=bang.Branch6,
    chamfer=bang.Branch7,
    inner_convexity=bang.Branch8,
    convexity_graph=bang.Branch9)  # -> simplify(segment_pt_group), simplify(segment_points), middle_polyline
points = PointList(Points=cluster_2.segment_points, Size=2.35)
pline = PolyLine(Vertices=cluster_2.segment_points, Closed=True)  # -> flatten(Polyline)
loft_mesh = Python3Script(S=pline)  # -> M; inputs S: list of Curve; same code as loft_mesh
tstat = TreeStatistics(Tree=cluster_2.segment_pt_group)  # -> Paths, Length, Count
item_2 = ListItem(List=tstat.Paths, Index=0, Wrap=True)  # -> Item1, Item
branch = TreeBranch(Tree=cluster_2.segment_pt_group, Path=item_2.Item, MaintainPaths=True)
branch_2 = TreeBranch(Tree=cluster_2.segment_pt_group, Path=item_2.Item1, MaintainPaths=True)
ungroup = Ungroup(Group=branch_2)
ungroup_2 = Ungroup(Group=branch)
cluster_3 = Cluster_6(pts=ungroup)
cluster_4 = Cluster_6(pts=ungroup_2)
cluster_5 = Cluster_7(M=cluster_4, D=Slider(7.18, range=0..10), descay=Slider(0.396, range=0..1))
cluster_6 = Cluster_7(M=cluster_3, D=neg, descay=Slider(0.794, range=0..1))
mesh_join = CSharpScript(M=flatten([cluster_6, loft_mesh, cluster_5]))  # -> Mesh; inputs M: list of Mesh
# ---------- mesh_join: C# ----------
// Grasshopper Script Instance
#region Usings
using System;
using System.Linq;
using System.Collections;
using System.Collections.Generic;
using System.Drawing;

using Rhino;
using Rhino.Geometry;

using Grasshopper;
using Grasshopper.Kernel;
using Grasshopper.Kernel.Data;
using Grasshopper.Kernel.Types;
#endregion

public class Script_Instance : GH_ScriptInstance
{
    #region Notes
    /* 
      Members:
        RhinoDoc RhinoDocument
        GH_Document GrasshopperDocument
        IGH_Component Component
        int Iteration

      Methods (Virtual & overridable):
        Print(string text)
        Print(string format, params object[] args)
        Reflect(object obj)
        Reflect(object obj, string method_name)
    */
    #endregion

    private void RunScript(List<Mesh> M, ref object Mesh)
    {
        // Write your logic here
        Mesh m = new Mesh();
        foreach (var item in M)
        {
            m.Append(item);
        }
        m.Weld(Math.PI);
        m.UnifyNormals();
        Mesh = m;
    }
}
# ---------- end mesh_join ----------
# Inside surface
offset_mesh = Python3Script(M=mesh_join, D="1")  # -> M; inputs M: Mesh, D: Double, C: Boolean
# ---------- offset_mesh: Python ----------
"""Grasshopper Script Instance"""
import System
import Rhino
import Grasshopper

import rhinoscriptsyntax as rs
import Rhino.Geometry as rg

class MyComponent(Grasshopper.Kernel.GH_ScriptInstance):
    def RunScript(self, M: Rhino.Geometry.Mesh, D: float, C: bool):
        
        if not C:
            C = False
        
        mesh = M.Offset(D, C)

        return mesh
# ---------- end offset_mesh ----------
subdmesh = SubDFromMesh(Mesh=offset_mesh, Creases=1, Corners=1, Interpolate=False)
subdmesh_2 = SubDFromMesh(Mesh=mesh_join, Creases=1, Corners=1, Interpolate=False)

subdedges = SubDEdges(SubD=subdmesh_2, NewFormatting=False)  # -> Line, Edge, Tag, Id
midpt = CurveMiddle(Curve=subdedges.Edge)
c_script_2 = CSharpScript(C=subdedges.Edge)  # -> G; inputs C: list of Curve
# ---------- c_script_2: C# ----------
// Grasshopper Script Instance
#region Usings
using System;
using System.Linq;
using System.Collections;
using System.Collections.Generic;
using System.Drawing;

using Rhino;
using Rhino.Geometry;

using Grasshopper;
using Grasshopper.Kernel;
using Grasshopper.Kernel.Data;
using Grasshopper.Kernel.Types;
#endregion

public class Script_Instance : GH_ScriptInstance
{
    #region Notes
    /* 
      Members:
        RhinoDoc RhinoDocument
        GH_Document GrasshopperDocument
        IGH_Component Component
        int Iteration

      Methods (Virtual & overridable):
        Print(string text)
        Print(string format, params object[] args)
        Reflect(object obj)
        Reflect(object obj, string method_name)
    */
    #endregion

    private void RunScript(List<Curve> C, ref object G)
    {
        // Write your logic here
        double t = this.RhinoDocument.ModelAbsoluteTolerance;
    int n = C.Count;
    Point3d[] PS = new Point3d[n];
    Point3d[] PE = new Point3d[n];
    Vector3d[] TS = new Vector3d[n];
    Vector3d[] TE = new Vector3d[n];
    bool[] uS = new bool[n];
    bool[] uE = new bool[n];
    int[] iS = new int[n];
    int[] iE = new int[n];
    bool[] used = new bool[n];
    for(int i = 0;i < n;i++){
      PS[i] = C[i].PointAtStart;
      PE[i] = C[i].PointAtEnd;
      TS[i] = C[i].TangentAtStart;
      TE[i] = C[i].TangentAtEnd;
      iS[i] = -1;
      iE[i] = -1;
      if(C[i].IsPeriodic){
        iS[i] = i;
        iE[i] = i;
      }
    }
    for(int i = 0;i < n;i++){
      for(int j = 0;j < n;j++){if(i != j){
          if(!uS[i] && !uS[j] && (PS[i].DistanceTo(PS[j]) < t) && (Math.Sin(Rhino.Geometry.Vector3d.VectorAngle(TS[i], TS[j])) < 0.001)){
            uS[i] = true; uS[j] = true; iS[i] = j; iS[j] = i;
          }
          if(!uS[i] && !uE[j] && (PS[i].DistanceTo(PE[j]) < t) && (Math.Sin(Rhino.Geometry.Vector3d.VectorAngle(TS[i], TE[j])) < 0.001)){
            uS[i] = true; uE[j] = true; iS[i] = j; iE[j] = i;
          }
          if(!uE[i] && !uS[j] && (PE[i].DistanceTo(PS[j]) < t) && (Math.Sin(Rhino.Geometry.Vector3d.VectorAngle(TE[i], TS[j])) < 0.001)){
            uE[i] = true; uS[j] = true; iE[i] = j; iS[j] = i;
          }
          if(!uE[i] && !uE[j] && (PE[i].DistanceTo(PE[j]) < t) && (Math.Sin(Rhino.Geometry.Vector3d.VectorAngle(TE[i], TE[j])) < 0.001)){
            uE[i] = true; uE[j] = true; iE[i] = j; iE[j] = i;
          }
        }}
    }
    Grasshopper.DataTree<int> tree = new Grasshopper.DataTree<int>();
    int loop = 0;
    int curr = 0;
    int old = -1;
    for(int i = 0;i < n;i++){
      curr = i;
      if(!used[curr]){
        tree.Add(curr, new GH_Path(loop));
        used[curr] = true;

        if(!uS[curr] && !uE[curr]){
          loop++;
          continue;
        }
        if(uE[curr]){
          for(int k = 0;k < 100;k++){
            if(uE[curr] && (iE[curr] != old) && (iE[curr] != i) && !used[iE[curr]]){
              old = curr;
              curr = iE[curr];
              tree.Add(curr, new GH_Path(loop));
              used[curr] = true;
            }else if(uS[curr] && (iS[curr] != old) && (iS[curr] != i) && !used[iS[curr]]){
              old = curr;
              curr = iS[curr];
              tree.Add(curr, new GH_Path(loop));
              used[curr] = true;
            }else{break;}
          }
        }
        old = -1;
        curr = i;
        if(uS[curr]){
          for(int k = 0;k < 100;k++){
            if(uE[curr] && (iE[curr] != old) && (iE[curr] != i) && !used[iE[curr]]){
              old = curr;
              curr = iE[curr];
              tree.Add(curr, new GH_Path(loop));
              used[curr] = true;
            }else if(uS[curr] && (iS[curr] != old) && (iS[curr] != i) && !used[iS[curr]]){
              old = curr;
              curr = iS[curr];
              tree.Add(curr, new GH_Path(loop));
              used[curr] = true;
            }else{break;}
          }
        }
        loop++;
      }
    }
    G = tree;
    }
}
# ---------- end c_script_2 ----------
points_2 = PointList(Points=midpt)
c_script_3 = CSharpScript(T=c_script_2, i="121")  # -> B; inputs T: tree of Int32, i: Int32
# ---------- c_script_3: C# ----------
// Grasshopper Script Instance
#region Usings
using System;
using System.Linq;
using System.Collections;
using System.Collections.Generic;
using System.Drawing;

using Rhino;
using Rhino.Geometry;

using Grasshopper;
using Grasshopper.Kernel;
using Grasshopper.Kernel.Data;
using Grasshopper.Kernel.Types;
#endregion

public class Script_Instance : GH_ScriptInstance
{
    #region Notes
    /* 
      Members:
        RhinoDoc RhinoDocument
        GH_Document GrasshopperDocument
        IGH_Component Component
        int Iteration

      Methods (Virtual & overridable):
        Print(string text)
        Print(string format, params object[] args)
        Reflect(object obj)
        Reflect(object obj, string method_name)
    */
    #endregion

    private void RunScript(DataTree<int> T, int i, ref object B)
    {
        // Write your logic here
      for(int p = 0; p < T.BranchCount; p++){
      List<int> list = T.Branch(p);
      foreach(int a in list){
        if(a == i){B = list;break;}
      }
    }
    }
}
# ---------- end c_script_3 ----------
subd_to_nurbs = Python3Script(S=subdmesh_2, Ex=4)  # -> B; inputs S: SubD, Ex: Int32; same code as subd_to_nurbs
item_3 = ListItem(List=subdedges.Edge, Index=c_script_3, Wrap=True)
join = JoinCurves(Curves=item_3, Preserve=False)

subdedges_2 = SubDEdges(SubD=subdmesh, NewFormatting=False)  # -> Line, Edge, Tag, Id
midpt_2 = CurveMiddle(Curve=subdedges_2.Edge)
c_script_4 = CSharpScript(C=subdedges_2.Edge)  # -> G; inputs C: list of Curve; same code as c_script_2
points_3 = PointList(Points=midpt_2)
subd_to_nurbs_2 = Python3Script(S=subdmesh, Ex=4)  # -> B; inputs S: SubD, Ex: Int32; same code as subd_to_nurbs
c_script_5 = CSharpScript(T=c_script_4, i="121")  # -> B; inputs T: tree of Int32, i: Int32; same code as c_script_3
item_4 = ListItem(List=subdedges_2.Edge, Index=c_script_5, Wrap=True)
join_2 = JoinCurves(Curves=item_4, Preserve=False)

subdpoly = SubDControlPolygon(SubD=subdmesh_2)
medges = MeshEdges(Mesh=subdpoly)  # -> NakedEdges, InteriorEdges, NonManifoldEdges

cluster_7 = Cluster_3(L=cluster_2.segment_points, S=Slider(2, range=0..10), D=Slider(8, range=0..30), ex=Slider(4, range=0..10))
c_script_6 = CSharpScript(B=cluster_7)  # -> S; inputs B: Brep
# ---------- c_script_6: C# ----------
// Grasshopper Script Instance
#region Usings
using System;
using System.Linq;
using System.Collections;
using System.Collections.Generic;
using System.Drawing;

using Rhino;
using Rhino.Geometry;

using Grasshopper;
using Grasshopper.Kernel;
using Grasshopper.Kernel.Data;
using Grasshopper.Kernel.Types;
#endregion

public class Script_Instance : GH_ScriptInstance
{
    #region Notes
    /* 
      Members:
        RhinoDoc RhinoDocument
        GH_Document GrasshopperDocument
        IGH_Component Component
        int Iteration

      Methods (Virtual & overridable):
        Print(string text)
        Print(string format, params object[] args)
        Reflect(object obj)
        Reflect(object obj, string method_name)
    */
    #endregion

    private void RunScript(Brep B, ref object S)
    {
        for (int i = 0; i < B.Surfaces.Count; i++) {
            bool a = B.Faces[i].ShrinkSurfaceToEdge();
            Console.WriteLine(a);
        }

        S = B;
      
    }
}
# ---------- end c_script_6 ----------

number_slider_4 = Slider(0.3, range=0..1)
subtraction = Subtraction(A=1, B=number_slider_4)
subtraction_2 = Subtraction(A=1, B=Slider(0.24, range=0..1))
dom_5 = ConstructDomain(DomainStart=number_slider_4, DomainEnd=subtraction)
dom_6 = ConstructDomain(DomainStart=Slider(0.37, range=0..1), DomainEnd=subtraction_2)
dom² = ConstructDomain²(DomainU=dom_5, DomainV=dom_6)
subsrf = Isotrim(Surface=reparameterize(c_script_6), Domain=dom²)

bbox = BoundingBox(Content=subdmesh_2, Plane=pframe)  # -> Box, Box_2
edges = BrepEdges(Brep=bbox.Box)  # -> Naked, Interior, NonManifold
py3 = Python3Script(B=bbox.Box)  # -> pts, U, V, W; inputs B: Box
# ---------- py3: Python ----------
import Rhino.Geometry as rg
pts = B.GetCorners()
U = B.X[1] - B.X[0]
V = B.Y[1] - B.Y[0]
W = B.Z[1] - B.Z[0]
# ---------- end py3 ----------
item_5 = ListItem(List=py3.pts, Index=0, Wrap=True)  # -> Item, Item1, Item2, Item3, Item4
ln = Line(StartPoint=item_5.Item, EndPoint=item_5.Item1)
ln_2 = Line(StartPoint=item_5.Item, EndPoint=item_5.Item4)
ln_3 = Line(StartPoint=item_5.Item1, EndPoint=item_5.Item2)

volume = Volume(Geometry=bbox.Box)  # -> Volume, Centroid
panel_2 = Panel(volume.Volume)
pipe = Pipe(Curve=join, Radius=1, Caps=0)
pipe_2 = Pipe(Curve=join_2, Radius=1, Caps=0)
dim = Dimensions(Surface=subsrf)  # -> UDimension, VDimension
split = SplitBrep(Brep=subd_to_nurbs_2, Cutter=pipe_2)
split_2 = SplitBrep(Brep=subd_to_nurbs, Cutter=pipe)
item_6 = ListItem(List=split_2, Index=0, Wrap=True)  # -> Item, Item1, Item2
item_7 = ListItem(List=split, Index=0, Wrap=True)  # -> Item, Item1, Item2
panel_3 = Panel(dim.VDimension)
panel_4 = Panel(dim.UDimension)
cluster_8 = Cluster_4(S=subsrf, U=Slider(3, range=0..100), V=Slider(5, range=0..100), R=radius, H=height, G=gap)  # disabled

preview = CustomPreview(Geometry=flatten([subdmesh_2, cluster_8, subdmesh]), Material=ColourSwatch(SwatchColor=RGB(194, 29, 29)))
preview_2 = CustomPreview(Geometry=edges.Interior, Material="white")
curve_preview = CustomCurvePreview(Curve=medges.InteriorEdges, Colour=RGB(0, 0, 0))
linedim = LineDimension(Line=[ln, ln_3, ln_2], Text="{0:0.00}", Size=Slider(2.25, range=0..10))

group = Group(Geometry=cluster_8)  # -> flatten(Group)
group_2 = Group(Geometry=group)
cluster_9 = Cluster_8(A=item_6.Item1, B=item_7.Item1)
cluster_10 = Cluster_8(A=item_6.Item2, B=item_7.Item2)
cluster_11 = Cluster_8(A=item_6.Item, B=item_7.Item)
join_3 = BrepJoin(Breps=flatten([item_6.Item1, item_7.Item1, cluster_9]))  # -> Breps, Closed
join_4 = BrepJoin(Breps=flatten([item_6.Item, item_7.Item, cluster_11]))  # -> Breps, Closed
join_5 = BrepJoin(Breps=flatten([item_6.Item2, item_7.Item2, cluster_10]))  # -> Breps, Closed
merge_2 = Merge(Data1=group_2, Data2=join_3.Breps)
move = Move(Geometry=merge_2, Motion=Y)  # -> Geometry, Transform

# ==== cluster Cluster
inner_convexity = ClusterInput()
length_range = ClusterInput()
width_range = ClusterInput()
x_segements = ClusterInput()
y_segements = ClusterInput()
convexity_graph = ClusterInput()
bend_graph = ClusterInput()
chamfer = ClusterInput()
plane = ClusterInput()
bend = ClusterInput()
multiplication = Multiplication(A=convexity_graph, B=graft(inner_convexity))
dom = ConstructDomain(DomainStart=bend, DomainEnd=0)
deplane = DeconstructPlane(Plane=plane)  # -> Origin, XAxis, YAxis, ZAxis
X = UnitX(Factor=length_range)
remap = RemapNumbers(Value=bend_graph, Source=Domain(1, 0), Target=dom)  # -> Mapped, Clipped
parabola = Python3Script(N=x_segements, D="1", Inv="1")  # -> R; inputs N: Int32, D: Int32, Inv: Boolean
#   port N: Number of steps
#   port D: 0 = (0 To 1) 1 = (-1 To 1)
# ---------- parabola: Python ----------
if not N:
    N = 10

types = [(0, 1),
         (-1, 1)]
R = []
start, end = types[D]
diff = end - start
step = diff / N
N += 1
for i in range(N):
    f = (start + i * step) ** 2
    if Inv:
        R.append(end - f)
    else:
        R.append(f)
# ---------- end parabola ----------

subtraction = Subtraction(A=1, B=parabola)
neg = Negative(Value=subtraction)

multiplication_2 = Multiplication(A=neg, B=graft(remap.Mapped))
move = Move(Geometry=plane, Motion=expr("-x", X))  # -> Geometry, Transform
move_2 = Move(Geometry=plane, Motion=X)  # -> Geometry, Transform
multiplication_3 = Multiplication(A=graft(deplane.YAxis), B=multiplication_2)
ln = Line(StartPoint=move.Geometry, EndPoint=move_2.Geometry)
neg_2 = Negative(Value=multiplication_3)
divide = DivideCurve(Curve=ln, Count=x_segements, Kinks=False)  # -> Points, Tangents, Parameters
move_3 = Move(Geometry=divide.Points, Motion=neg_2)  # -> Geometry, Transform
pline = PolyLine(Vertices=move_3.Geometry, Closed=False)
multiplication_4 = Multiplication(A=graft(deplane.YAxis), B=multiplication)
middle_polyline = ClusterOutput(pline)
offset = OffsetCurve(Curve=pline, Distance=expr("x/2", graft(width_range)), Plane=graft(plane), Corners=1)
offset_2 = OffsetCurve(Curve=pline, Distance=expr("-x/2", graft(width_range)), Plane=graft(plane), Corners=1)
end = EndPoints(Curve=offset)  # -> Start, End
end_2 = EndPoints(Curve=offset_2)  # -> Start, End
ln_2 = Line(StartPoint=end.Start, EndPoint=end_2.Start)
ln_3 = Line(StartPoint=end.End, EndPoint=end_2.End)
trim_curve = TrimCurve(C=offset, D=chamfer)  # -> Crv; inputs C: Curve, D: Double, E: Int32
#   port E: None = 0 Start = 1 End = 2 Both = 3
# ---------- trim_curve: Python ----------
import Rhino.Geometry as rg
if not E:
    E = 3
if not D:
    D = 0
try:
    if D:
        Crv = C.Trim(rg.CurveEnd(E), D)
    else:
        Crv = C
except:
    pass
# ---------- end trim_curve ----------
trim_curve_2 = TrimCurve(C=offset_2, D=chamfer)  # -> Crv; inputs C: Curve, D: Double, E: Int32; same code as trim_curve
trim_curve_3 = TrimCurve(C=ln_2, D=chamfer)  # -> Crv; inputs C: Curve, D: Double, E: Int32; same code as trim_curve
trim_curve_4 = TrimCurve(C=ln_3, D=chamfer)  # -> Crv; inputs C: Curve, D: Double, E: Int32; same code as trim_curve
divide_2 = DivideCurve(Curve=trim_curve_2, Count=x_segements, Kinks=False)  # -> reverse(Points), Tangents, Parameters
divide_3 = DivideCurve(Curve=trim_curve, Count=x_segements, Kinks=False)  # -> Points, Tangents, Parameters
divide_4 = DivideCurve(Curve=trim_curve_4, Count=y_segements, Kinks=False)  # -> Points, Tangents, Parameters
divide_5 = DivideCurve(Curve=trim_curve_3, Count=y_segements, Kinks=False)  # -> reverse(Points), Tangents, Parameters

# ---- group: Inner Convexity
move_4 = Move(Geometry=divide_2.Points, Motion=multiplication_4)  # -> Geometry, Transform

# ----
group = Group(Objects=divide_5.Points)
group_2 = Group(Objects=divide_3.Points)
group_3 = Group(Objects=move_4.Geometry)
group_4 = Group(Objects=divide_4.Points)
weave = Weave(Pattern=[0, 1, 2, 3], Stream0=group, Stream1=group_2, Stream2=group_4, Stream3=group_3, NullGaps=False)
ungroup = Ungroup(Group=weave)
pshift = ShiftPaths(Data=ungroup, Offset=-1)  # -> simplify(Data)
segment_pt_group = ClusterOutput(weave)
segment_points = ClusterOutput(pshift)

# ==== cluster Cluster_2
P = ClusterInput()
pdecon = Deconstruct(Point=P)  # -> XComponent, YComponent, ZComponent
C = ClusterInput()
pt = ConstructPoint(XCoordinate=pdecon.XComponent, YCoordinate=0, ZCoordinate=pdecon.ZComponent)
pcx = CurvePlane(Curve=C, Plane=pt)  # -> Points, ParamsC, ParamsP
pdecon_2 = Deconstruct(Point=pcx.ParamsP)  # -> flatten(XComponent), YComponent, ZComponent
X = ClusterOutput(pdecon_2.XComponent)

# ==== cluster Cluster_3
L = ClusterInput()
S = ClusterInput()
shift = ShiftList(List=L, Shift=S, Wrap=True)
D = ClusterInput()
subset = SubList(List=reverse(shift), Domain=D, Wrap=True)  # -> List, Index
pline = PolyLine(Vertices=subset.List, Closed=False)  # -> flatten(Polyline)
loft_mesh = Python3Script(S=pline)  # -> M; inputs S: list of Curve
# ---------- loft_mesh: Python ----------
"""Grasshopper Script Instance"""
import System
import Rhino
import Grasshopper

import Rhino.Geometry as rg
import rhinoscriptsyntax as rs
from math import ceil, pi
import ghpythonlib.components as gc


class MyComponent(Grasshopper.Kernel.GH_ScriptInstance):
    def RunScript(self, S: System.Collections.Generic.List[Rhino.Geometry.Curve]):
        
        M = rg.Mesh()
        for k in range(len(S)-1):

            pl1 = S[k].ToNurbsCurve().Points
            pts1 = []
            for j in range(pl1.Count):
                pts1.append(rg.Point3d(pl1[j].X, pl1[j].Y, pl1[j].Z))
            pl2 = S[k+1].ToNurbsCurve().Points
            pts2 = []
            for l in range(pl2.Count):
                pts2.append(rg.Point3d(pl2[l].X, pl2[l].Y, pl2[l].Z))   
            
            pts2.reverse()
            V = pts1 + pts2

            face_n = int((len(V)-2)/2)
            
            n = [i for i in range(len(V))]
            Faces = []
            for i in range(face_n):
                cb = '{}'
                ch = f'Q{cb[0]}{n[0]};{n[1]};{n[-2]};{n[-1]}{cb[1]}'
                Faces.append(ch)
                n.pop(-1)
                n.pop(0)
            
            mesh = gc.ConstructMesh(V, Faces)
            M.Append(mesh)
        M.Weld(pi)
        return M
# ---------- end loft_mesh ----------
flipm = FlipMesh(Mesh=loft_mesh, VertexNormals=True, FaceNormals=True, FaceOrientation=True)
subdmesh = SubDFromMesh(Mesh=flipm, Creases=1, Corners=1, Interpolate=False)
ex = ClusterInput()
subd_to_nurbs = Python3Script(S=subdmesh, Ex=ex)  # -> B; inputs S: SubD, Ex: Int32
#   port Ex: None = 0 LocalG1 = 1 LocalG2 = 2 LocalG1x = 3 LocalG1xx = 4
# ---------- subd_to_nurbs: Python ----------
import Rhino.Geometry as rg
if Ex > 4:
    raise ValueError('This option doesn\'nt exist. (0, 4)')
opt = rg.SubDToBrepOptions()
opt.PackFaces = True
evp = rg.SubDToBrepOptions.ExtraordinaryVertexProcessOption(Ex)
opt.ExtraordinaryVertexProcess = evp
B = S.ToBrep(opt)
# ---------- end subd_to_nurbs ----------
B = ClusterOutput(subd_to_nurbs)

# ==== cluster Cluster_4
S = ClusterInput()
R = ClusterInput()
H = ClusterInput()
G = ClusterInput()
U = ClusterInput()
V = ClusterInput()
sdivide = DivideSurface(Surface=S, UCount=U, VCount=V)  # -> Points, Normals, Parameters
flip = FlipMatrix(Data=sdivide.Points)
intcrv = Interpolate(Vertices=flip, Degree=3, Periodic=False, KnotStyle=1)  # -> Curve, Length, Domain
multiplication = Multiplication(A=R, B=2)
len = Length(Curve=intcrv.Curve)
addition = Addition(A=multiplication, B=G)
division = Division(A=len, B=addition)
int = Integer(division)
divide = DivideCurve(Curve=intcrv.Curve, Count=int, Kinks=False)  # -> Points, Tangents, Parameters
srf_cp = SurfaceClosestPoint(Point=divide.Points, Surface=S)  # -> Point, UVPoint, Distance
evalsrf = EvaluateSurface(Surface=S, Point=srf_cp.UVPoint)  # -> Point, Normal, UDirection, VDirection, Frame
sph = Sphere(Base=evalsrf.Point, Radius=R)
cir = Circle(Plane=evalsrf.Frame, Radius=R)
srfsplit = SurfaceSplit(Surface=graft(sph), Curves=graft(cir))
item = ListItem(List=srfsplit, Index=0, Wrap=True)
pshift = ShiftPaths(Data=item, Offset=-2)  # -> simplify(Data)
cyl = Cylinder(Base=evalsrf.Frame, Radius=R, Length=expr("-x", H))
scale_nu = ScaleNU(Geometry=pshift, Plane=simplify(evalsrf.Frame), ScaleX=1, ScaleY=1, ScaleZ=Slider(0.2, range=0..1))  # -> Geometry, Transform
weave = Weave(Pattern=[0, 1], Stream0=graft(cyl), Stream1=graft(scale_nu.Geometry), NullGaps=False)
join = BrepJoin(Breps=weave)  # -> Breps, Closed
pshift_2 = ShiftPaths(Data=join.Breps, Offset=-2)  # -> simplify(Data)
geometry = ClusterOutput(pshift_2)

# ==== cluster Cluster_6
pts = ClusterInput()
bang = ExplodeTree(Data=pts)  # -> Branch0, Branch1, Branch2, Branch3
pline = PolyLine(Vertices=flatten(pts), Closed=True)
pline_2 = PolyLine(Vertices=bang.Branch2, Closed=False)
lng = ListLength(List=bang.Branch2)
len = Length(Curve=pline_2)
group = Group(Geometry=reverse(bang.Branch0))  # -> flatten(Group)
group_2 = Group(Geometry=bang.Branch2)  # -> flatten(Group)
ln = Line(StartPoint=bang.Branch1, EndPoint=reverse(bang.Branch3))
len_2 = Length(Curve=ln)
expression = Expression(x=len_2, y=len, Expression="(x-y)/2")
py3 = Python3Script(C=ln, D=expression)  # -> Crv; inputs C: Curve, D: Double, E: Int32
# ---------- py3: Python ----------
"""Grasshopper Script Instance"""
import System
import Rhino
import Grasshopper

import rhinoscriptsyntax as rs
import Rhino.Geometry as rg

class MyComponent(Grasshopper.Kernel.GH_ScriptInstance):
    def RunScript(self, C: Rhino.Geometry.Curve, D: float, E: int):
        if not E:
            E = 3
        if not D:
            D = 0
        try:
            if D:
                Crv = C.Trim(rg.CurveEnd(E), D)
            else:
                Crv = C
        except:
            pass
        return Crv
# ---------- end py3 ----------
divide = DivideCurve(Curve=py3, Count=expr("x-1", lng), Kinks=False)  # -> Points, Tangents, Parameters
group_3 = Group(Geometry=divide.Points)  # -> flatten(Group)
ins = InsertItems(List=group_3, Item=[group, group_2], Indices=[0, -1], Wrap=True)
ungroup = Ungroup(Group=ins)
flip = FlipMatrix(Data=ungroup)
pline_3 = PolyLine(Vertices=flip, Closed=False)  # -> flatten(Polyline)
explode = Explode(Curve=pline, Recursive=True)  # -> Segments, Vertices
cluster = Cluster_5(ca=pline_3, cb=ln)
cluster_2 = Cluster_5(ca=ln, cb=pline_3)
merge = Merge(Data1=explode.Segments, Data2=cluster, Data3=cluster_2)  # -> flatten(Result)
c_script = CSharpScript(L=merge, T="0.01")  # -> M; inputs L: list of Curve, T: Double
# ---------- c_script: C# ----------
// Grasshopper Script Instance
#region Usings
using System;
using System.Linq;
using System.Collections;
using System.Collections.Generic;
using System.Drawing;

using Rhino;
using Rhino.Geometry;

using Grasshopper;
using Grasshopper.Kernel;
using Grasshopper.Kernel.Data;
using Grasshopper.Kernel.Types;
#endregion

public class Script_Instance : GH_ScriptInstance
{
    #region Notes
    /* 
      Members:
        RhinoDoc RhinoDocument
        GH_Document GrasshopperDocument
        IGH_Component Component
        int Iteration

      Methods (Virtual & overridable):
        Print(string text)
        Print(string format, params object[] args)
        Reflect(object obj)
        Reflect(object obj, string method_name)
    */
    #endregion

    private void RunScript(List<Curve> L, double T, ref object M)
    {

        // Convert L to an array
        Curve[] L_array = L.ToArray();

        // Pass the array to CreateFromLines
        Mesh mesh = Mesh.CreateFromLines(L_array, 4, T);

        M = mesh;
    }
}
# ---------- end c_script ----------
mesh = ClusterOutput(c_script)

# ==== cluster Cluster_7
M = ClusterInput()
D = ClusterInput()
nv = NakedVertices(Mesh=M)  # -> ClothedIndex, NakedIndex, ClothedPts, NakedPts
demesh = DeconstructMesh(Mesh=M)  # -> Vertices, Faces, Colours, Normals
py3 = Python3Script(L=demesh.Vertices)  # -> N; inputs L: list
# ---------- py3: Python ----------
"""Grasshopper Script"""
import System
import Rhino
import Grasshopper

import rhinoscriptsyntax as rs

class MyComponent(Grasshopper.Kernel.GH_ScriptInstance):
    def RunScript(self, L: System.Collections.Generic.List[object]):
        a = int(len(L)/6)
        
        return a
# ---------- end py3 ----------
series = Series(Start=10, Step=5, Count=expr("x-2", py3))
descay = ClusterInput()
item = ListItem(List=demesh.Vertices, Index=nv.ClothedIndex, Wrap=True)
item_2 = ListItem(List=demesh.Vertices, Index=series, Wrap=True)
item_3 = ListItem(List=demesh.Normals, Index=nv.ClothedIndex, Wrap=True)
pline = PolyLine(Vertices=item_2, Closed=False)
dom = ConstructDomain(DomainStart=1, DomainEnd=descay)
crv_cp = CurveClosestPoint(Point=item, Curve=pline)  # -> Point, Parameter, Distance
bnd = Bounds(Numbers=crv_cp.Distance)
remap = RemapNumbers(Value=crv_cp.Distance, Source=bnd, Target=dom)  # -> Mapped, Clipped
multiplication = Multiplication(A=D, B=remap.Mapped)
amp = Amplitude(Vector=item_3, Amplitude=multiplication)
move = Move(Geometry=item, Motion=amp)  # -> Geometry, Transform
replace = ReplaceItems(List=demesh.Vertices, Item=move.Geometry, Indices=nv.ClothedIndex, Wrap=False)
conmesh = ConstructMesh(Vertices=replace, Faces=demesh.Faces)
mesh = ClusterOutput(conmesh)

# ==== cluster Cluster_8
A = ClusterInput()
B = ClusterInput()
edges = BrepEdges(Brep=A)  # -> Naked, Interior, NonManifold
edges_2 = BrepEdges(Brep=B)  # -> Naked, Interior, NonManifold
crv = Curve(edges.Naked)
crv_2 = Curve(edges_2.Naked)
join = JoinCurves(Curves=crv, Preserve=False)
join_2 = JoinCurves(Curves=crv_2, Preserve=False)
weave = Weave(Pattern=[0, 1], Stream0=graft(join), Stream1=graft(join_2), NullGaps=False)  # -> simplify(Weave)
loft = Loft(Curves=weave, Options={Adjust=False, Closed=False, LoftEnds=0, LoftSimp=0, LoftType=0, Rebuild=10, Refit=0.01})  # -> flatten(Loft)
surface = ClusterOutput(loft)

# ==== cluster Cluster_5
ca = ClusterInput()
cb = ClusterInput()
ccx = CurveCurve(CurveA=graft(ca), CurveB=cb)  # -> Points, ParamsA, ParamsB
pshift = ShiftPaths(Data=ccx.ParamsA, Offset=-1)
shatter = Shatter(Curve=graft(ca), Parameters=pshift)
curve = ClusterOutput(shatter)
